# Dynamo graph Загатовка.dyn (Dynamo 2.0.2.6826)

file_path = Filename("..\ExtensibleStorage_Create.py")
file_from_path = FileObject(path=file_path)
readText = FileSystem.ReadText(file=file_from_path)
boolean = BoolSelector(false)
python_script_from_string = PythonStringNode(script=readText, IN[0]=boolean)
type = Object.Type(obj=python_script_from_string)
