# Dynamo graph UNI_Rooms.Department.dyn (Dynamo 2.3.0.5885)

file_path = Filename("C:\Dynamo\08_UNIPRO\04_Rooms_Classification.py")
file_from_path = FileObject(path=file_path)
readText = FileSystem.ReadText(file=file_from_path)
categories = Categories("OST_Rooms")
all_elements_of_category = ElementsOfCategory(Category=categories)
code_block = CodeBlock(a=all_elements_of_category) { a.Name; }
sortByKey = List.SortByKey(list=all_elements_of_category, keys=code_block)
коммерческие_помещения = CodeBlock()
# ---------- коммерческие_помещения.designscript (3 lines) ----------
String.Split(
"БКТ,УНИВЕРСАЛЬНЫЙ МАГАЗИН,КАФЕ"
, ",");
# ----------------------------------------
python_script_from_string = PythonStringNode(script=readText, IN[0]=sortByKey.sorted_list, IN[1]=коммерческие_помещения)
code_block_2 = CodeBlock(a=python_script_from_string) { a.Name; }
groupByKey = List.GroupByKey(list=sortByKey.sorted_list, keys=sortByKey.sorted_keys)
code_block_3 = CodeBlock(a=groupByKey.groups) { Element.GetParameterValueByName(a, "Department"); }
